# Dynamo graph PREENCHER-MEMORIAL_script.dyn (Dynamo 3.2.1.5366)
# packages: Data-Shapes 2025.3.118

string = StringInput("PRENCHER O MEMORIAL DESCRITVO")
string_2 = StringInput("PROEECHER")
string_3 = StringInput("CARREGAR O ARQUIVO")
filepath_data = Custom[FilePath Data](ButtonText=string_3)  # package Data-Shapes; Create filepath input for UI.MultipleInputForm ++ . Check out www.data-shapes.net for more infos !
string_4 = StringInput("COM GALERIA")
string_5 = StringInput(" SIM ")
string_6 = StringInput("NÃO")
list_create = List.Create(item0=string_5, item1=string_6)
radiobuttons_data = Custom[RadioButtons Data](InputName=string_4, Keys=list_create, Values=list_create)  # package Data-Shapes; Create radio buttons input for UI.MultipleInputForm ++ .
list_create_2 = List.Create(item0=filepath_data, item1=radiobuttons_data)
boolean = BoolSelector(true)
string_7 = StringInput("CANCELAR")
multipleinputform = Custom[MultipleInputForm ++](Description_optional=string, ButtonText_optional=string_2, Inputs=list_create_2, Toggle=boolean, CancelButtonText_optional=string_7)  # package Data-Shapes; Create a form with multiple inputs. see www.data-shapes.net for tutorials and infos!
number = DoubleInput(0)
getItemAtIndex = List.GetItemAtIndex(list=multipleinputform.User_Inputs, index=number)
string_8 = StringInput("BASE")

# group: ÁREA CONSTRUÍDA
# Descrição <Clique duas vezes aqui para editar a descrição do grupo>
categories = Categories("OST_Areas")
all_elements_of_category = ElementsOfCategory(Category=categories)
string_9 = StringInput("TIPO DE CALCULO")
getParameterValueByName = Element.GetParameterValueByName(element=all_elements_of_category, parameterName=string_9)
string_10 = StringInput("TAXA DE OCUPAÇÃO")
eq = getParameterValueByName == string_10
filterByBoolMask = List.FilterByBoolMask(list=all_elements_of_category, mask=eq)
string_11 = StringInput("Área")
getParameterValueByName_2 = Element.GetParameterValueByName(element=filterByBoolMask.in, parameterName=string_11)
string_12 = StringInput("")
eq_2 = getParameterValueByName_2 == string_12
filterByBoolMask_2 = List.FilterByBoolMask(list=getParameterValueByName_2, mask=eq_2)
sum = Math.Sum(values=filterByBoolMask_2.out)
number_2 = DoubleInput(2)
round = Math.Round(number=sum, digits=number_2)
number_3 = DoubleInput(16)
number_4 = DoubleInput(4)
openXMLExportExcel = Data.OpenXMLExportExcel(filePath=getItemAtIndex, sheetName=string_8, data=round, startRow=number_3, startColumn=number_4)
number_5 = DoubleInput(2)
number_6 = DoubleInput(3)
openXMLExportExcel_2 = Data.OpenXMLExportExcel(filePath=getItemAtIndex, sheetName=string_8, data=round, startRow=number_5, startColumn=number_6)

# group: NUMERO DE PAVIMENTOS
# Descrição <Clique duas vezes aqui para editar a descrição do grupo>
categories_2 = Categories("OST_Areas")
all_elements_of_category_2 = ElementsOfCategory(Category=categories_2)
code_block = CodeBlock { "Nível"; }
getParameterValueByName_3 = Element.GetParameterValueByName(element=all_elements_of_category_2, parameterName=code_block)
groupByKey = List.GroupByKey(list=getParameterValueByName_3, keys=getParameterValueByName_3)
count = List.Count(list=groupByKey.uniqueKeys)
number_7 = DoubleInput(12)
number_8 = DoubleInput(4)
openXMLExportExcel_3 = Data.OpenXMLExportExcel(filePath=getItemAtIndex, sheetName=string_8, data=count, startRow=number_7, startColumn=number_8)

# group: NUMERO DE AMBIENTES
# Descrição <Clique duas vezes aqui para editar a descrição do grupo>
categories_3 = Categories("OST_Rooms")
all_elements_of_category_3 = ElementsOfCategory(Category=categories_3)
string_13 = StringInput("Área")
getParameterValueByName_4 = Element.GetParameterValueByName(element=all_elements_of_category_3, parameterName=string_13)
string_14 = StringInput("")
eq_3 = getParameterValueByName_4 == string_14
filterByBoolMask_3 = List.FilterByBoolMask(list=getParameterValueByName_4, mask=eq_3)
count_2 = List.Count(list=filterByBoolMask_3.out)
number_9 = DoubleInput(13)
number_10 = DoubleInput(4)
openXMLExportExcel_4 = Data.OpenXMLExportExcel(filePath=getItemAtIndex, sheetName=string_8, data=count_2, startRow=number_9, startColumn=number_10)

# group: NUMERO D CADEIRAS
# Descrição <Clique duas vezes aqui para editar a descrição do grupo>
categories_4 = Categories("OST_Furniture")
all_elements_of_category_4 = ElementsOfCategory(Category=categories_4)
string_15 = StringInput("Nº DE CADEIRAS")
getParameterValueByName_5 = Element.GetParameterValueByName(element=all_elements_of_category_4, parameterName=string_15)
code_block_2 = CodeBlock { ""; }
eq_4 = getParameterValueByName_5 == code_block_2
filterByBoolMask_4 = List.FilterByBoolMask(list=all_elements_of_category_4, mask=eq_4)
getParameterValueByName_6 = Element.GetParameterValueByName(element=filterByBoolMask_4.out, parameterName=string_15)
sum_2 = Math.Sum(values=getParameterValueByName_6)
number_11 = DoubleInput(14)
number_12 = DoubleInput(4)
openXMLExportExcel_5 = Data.OpenXMLExportExcel(filePath=getItemAtIndex, sheetName=string_8, data=sum_2, startRow=number_11, startColumn=number_12)

# group: ÁREA DO TERRENO
# Descrição <Clique duas vezes aqui para editar a descrição do grupo>
categories_5 = Categories("OST_Areas")
all_elements_of_category_5 = ElementsOfCategory(Category=categories_5)
string_16 = StringInput("Nome")
getParameterValueByName_7 = Element.GetParameterValueByName(element=all_elements_of_category_5, parameterName=string_16)
string_17 = StringInput("ÁREA DO TERRENO")
eq_5 = getParameterValueByName_7 == string_17
filterByBoolMask_5 = List.FilterByBoolMask(list=all_elements_of_category_5, mask=eq_5)
string_18 = StringInput("Área")
getParameterValueByName_8 = Element.GetParameterValueByName(element=filterByBoolMask_5.in, parameterName=string_18)
string_19 = StringInput("")
eq_6 = getParameterValueByName_8 == string_19
filterByBoolMask_6 = List.FilterByBoolMask(list=getParameterValueByName_8, mask=eq_6)
sum_3 = Math.Sum(values=filterByBoolMask_6.out)
number_13 = DoubleInput(2)
round_2 = Math.Round(number=sum_3, digits=number_13)
number_14 = DoubleInput(17)
number_15 = DoubleInput(4)
openXMLExportExcel_6 = Data.OpenXMLExportExcel(filePath=getItemAtIndex, sheetName=string_8, data=round_2, startRow=number_14, startColumn=number_15)

# group: NUMERO D EVAGAS DE ESTACIONAMENTO
# Descrição <Clique duas vezes aqui para editar a descrição do grupo>
categories_6 = Categories("OST_Parking")
all_elements_of_category_6 = ElementsOfCategory(Category=categories_6)
string_20 = StringInput("N VAGAS")
getParameterValueByName_9 = Element.GetParameterValueByName(element=all_elements_of_category_6, parameterName=string_20)
sum_4 = Math.Sum(values=getParameterValueByName_9)
number_16 = DoubleInput(18)
number_17 = DoubleInput(4)
openXMLExportExcel_7 = Data.OpenXMLExportExcel(filePath=getItemAtIndex, sheetName=string_8, data=sum_4, startRow=number_16, startColumn=number_17)

number_18 = DoubleInput(1)
getItemAtIndex_2 = List.GetItemAtIndex(list=multipleinputform.User_Inputs, index=number_18)

# group: COM OU SEM GALERIA
# Descrição <Clique duas vezes aqui para editar a descrição do grupo>
number_19 = DoubleInput(15)
number_20 = DoubleInput(4)
openXMLExportExcel_8 = Data.OpenXMLExportExcel(filePath=getItemAtIndex, sheetName=string_8, data=getItemAtIndex_2, startRow=number_19, startColumn=number_20)

# group: TAXA DE OCUPAÇÃO
# Descrição <Clique duas vezes aqui para editar a descrição do grupo>
code_block_3 = CodeBlock { "ÁREA DO TERRENO"; }
setParameterByName = Element.SetParameterByName(element=all_elements_of_category_5, parameterName=code_block_3, value=round_2)
