# Dynamo graph L - COTAS DE PAREDE AUTOMATICA_script.dyn (Dynamo 3.2.1.5366)
# packages: Genius Loci 2024.5.29, BIMCoder Nodes - 2.X 2025.1.0, Data-Shapes 2025.3.118

# group: SELECIONA UMA SUPERFICIE DE REFERENCIA
select_surfaceonelement = Custom[👓 Select․SurfaceOnElement]()  # package BIMCoder Nodes - 2.X; Habilita a seleção de uma superfície em um elemento
perimeterCurves = Surface.PerimeterCurves(surface=select_surfaceonelement)
code_block = CodeBlock { 0.5; }
pointAtParameter = Curve.PointAtParameter(curve=perimeterCurves, param=code_block)
Z = Point.Z(point=pointAtParameter)
sortByKey = List.SortByKey(list=perimeterCurves@L2, keys=Z@L2)
firstItem = List.FirstItem(list=sortByKey.sortedList@L2)
code_block_2 = CodeBlock { 0.5; }
normalAtParameter = Surface.NormalAtParameter(surface=select_surfaceonelement, u=code_block_2, v=code_block_2)
locateSurfacesByLine = PolySurface.LocateSurfacesByLine()  # unwired: polySurface, line

string = StringInput("COTAS AUTOMATICAS")
string_2 = StringInput("  CRIAR COTAS")
string_3 = StringInput("SELECIONAR AS PAREDES")
categories = Categories("OST_Walls")
selectmodelelements_data = Custom[SelectModelElements Data](ButtonText=string_3, CategoryFilter=categories)  # package Data-Shapes; Creates a Revit element selection input for UI.MultipleInputForm++ . Check out www.data-shapes.net for more infos!
boolean = BoolSelector(true)
string_4 = StringInput("CANCELAR")
multipleinputform = Custom[MultipleInputForm ++](Description_optional=string, ButtonText_optional=string_2, Inputs=selectmodelelements_data, Toggle=boolean, CancelButtonText_optional=string_4)  # package Data-Shapes; Create a form with multiple inputs. see www.data-shapes.net for tutorials and infos!
number = DoubleInput(0)
getItemAtIndex = List.GetItemAtIndex(list=multipleinputform.User_Inputs, index=number)

# group: LINHA COM BASE NA SUPERFICIE
direction = Line.Direction(line=firstItem)

# group: localizacao paredes em linhas
# situa as paredes para podermos darmos uma direçao em cada parede
getLocation = Element.GetLocation(element=getItemAtIndex)

# group: direção da parede
# permite sabermos em que direção cada parede esta, vertical ou horizontal e assim usarmos o proximo nó para encontrarmos os paralelos
direction_2 = Line.Direction(line=getLocation)

# group: paralelo?
# compara 2 vetores pra saber se sao paralelos
isParallel = Vector.IsParallel(vector=direction, otherVector=direction_2@L1, lacing=Longest)

# group: Resultado
# aqui ele filtra quais sao paralelas e quais nao sao.
# PEGAMOS TODAS AS PAREDES EM LIST, E DEFINIMOS QUAIS SAO PARALELAS COM EM MASK
filterByBoolMask = List.FilterByBoolMask(list=getItemAtIndex, mask=isParallel)

wall_extractsurfaces = Custom[👓 Wall․ExtractSurfaces](wall=filterByBoolMask.in)  # package BIMCoder Nodes - 2.X; Extrai as superfícies de uma parede, separando em superfícies da face (paralelas) e superfícies de espessura da parede (ortogonais)
wall_extractsurfaces_2 = Custom[👓 Wall․ExtractSurfaces](wall=filterByBoolMask.out)

# group: 1.CASO NAO FUNCIONE O SEGREDO PODE ESTAR AQUI
# MODIFIQUE O SURFACE REFERENCE EM L1,L2,L3, TESTE E ACHARÁ O MELHOR CAMINHO
# AQUI ESTA INTERSECÇÃO DE PAREDES E VÃOS
join = List.Join(list0=wall_extractsurfaces.ortoSurfaces, list1=wall_extractsurfaces_2.parallelSurfaces)
surface_reference = Custom[Surface Reference](surface=join@L1)  # package Genius Loci; Obtains the reference of a given Revit surface in the current document.
flatten = List.Flatten(list=surface_reference)

# group: Distancia da cota do projeto por offset em CM > ADICIONE O NOME DA SUA COTA
n1_digite_o_nome_da_cota_que_irá = StringInput("EXTERNA PRETA")  # "1.DIGITE O NOME DA COTA QUE IRÁ USAR"; graph input
dimension_typebyname = Custom[👓 Dimension․TypeByName](name=n1_digite_o_nome_da_cota_que_irá)  # package BIMCoder Nodes - 2.X; Obtém um tipo de cota (dimension) dado o nome do tipo

# group: por seleção
select_pointonscreen = Custom[👓 Select․PointOnScreen]()  # frozen; package BIMCoder Nodes - 2.X; Habilita a seleção de um ponto na tela
direction_3 = Line.Direction()  # frozen; unwired: line
code_block_3 = CodeBlock { 500; }  # frozen
byStartPointDirectionLength = Line.ByStartPointDirectionLength(startPoint=select_pointonscreen, direction=direction_3, length=code_block_3)

# group: Distancia da cota do projeto por offset em CM > 2.AQUI SELECIONAMOS APENAS AS PAREDES
flatten_2 = List.Flatten(list=wall_extractsurfaces_2.parallelSurfaces)
surface_reference_2 = Custom[Surface Reference](surface=flatten_2)

# group: 3.COTA 3
flatten_3 = List.Flatten(list=wall_extractsurfaces_2.parallelSurfaces)
code_block_4 = CodeBlock { 0.5; }
pointAtParameter_2 = Surface.PointAtParameter(surface=flatten_3, u=code_block_4, v=code_block_4)
point_sortbydirection = Custom[👓 Point․SortByDirection](points=pointAtParameter_2, direction=direction)  # package BIMCoder Nodes - 2.X; Ordena pontos com base em um vetor de direção
indexOf = List.IndexOf(list=pointAtParameter_2, element=point_sortbydirection)
getItemAtIndex_2 = List.GetItemAtIndex(list=flatten_3@L2, index=indexOf)

# group: 3.COTA 3 > 1 PAREDE INICIAL
code_block_5 = CodeBlock { 0; }
getItemAtIndex_3 = List.GetItemAtIndex(list=getItemAtIndex_2@L2, index=code_block_5)

# group: 3.COTA 3 > FINAL PAREDES -1
count = List.Count(list=getItemAtIndex_2@L2)
code_block_6 = CodeBlock { 1; }
sub = count - code_block_6
getItemAtIndex_4 = List.GetItemAtIndex(list=getItemAtIndex_2@L2, index=sub)

# group: 3.COTA 3 > OUTPUT
join_2 = List.Join(list0=getItemAtIndex_3, list1=getItemAtIndex_4)
flatten_4 = List.Flatten(list=join_2)
surface_reference_3 = Custom[Surface Reference](surface=flatten_4)

# group: Distancia da cota do projeto por offset em CM
n2_distancia_da_cota_em_relacao_a = DoubleInput(0.5)  # "2.DISTANCIA DA COTA EM RELACAO A PAREDE"; graph input
# note: LINHA DA COTA 1
translate = Geometry.Translate(geometry=firstItem, direction=normalAtParameter, distance=n2_distancia_da_cota_em_relacao_a)
dimension_byreferences = Custom[Dimension ByReferences](line=translate, references=flatten, dimensionType=dimension_typebyname)  # package Genius Loci; Creates a new linear dimension from at least two geometric references of an object.
n3_distancia_entre_cada_cota_cota = DoubleInput(0.5)  # "3.DISTANCIA ENTRE CADA COTA COTA"; graph input
# note: LINHA DA COTA 2
translate_2 = Geometry.Translate(geometry=translate, direction=normalAtParameter, distance=n3_distancia_entre_cada_cota_cota)
dimension_byreferences_2 = Custom[Dimension ByReferences](line=translate_2, references=surface_reference_2, dimensionType=dimension_typebyname)
# note: LINHA DA COTA 3
translate_3 = Geometry.Translate(geometry=translate_2, direction=normalAtParameter, distance=n3_distancia_entre_cada_cota_cota)
dimension_byreferences_3 = Custom[Dimension ByReferences](line=translate_3, references=surface_reference_3, dimensionType=dimension_typebyname)
